# Grasshopper definition assignment 1 code.gh (Grasshopper 1.0.7)
# plug-ins: Pufferfish

number_slider = Slider(0, range=0..10)
number_slider_2 = Slider(0, range=0..10)
number_slider_3 = Slider(0, range=0..10)

# ---- group: curve creation using points
series = Series(Start=Slider(0, range=0..100), Step=Slider(0.69, range=0..1), Count=Slider(17, range=0..100))
pt = ConstructPoint(XCoordinate=0, YCoordinate=0, ZCoordinate=0)
graph = GraphMapper(series, x0=0, x1=1.5, y0=0, y1=1, container_name="Sine", Equation_px=[0, 0.3080008328], Equation_py=[0, 1])
number_slider_4 = Slider(10, range=0..10)
Y = UnitY(Factor=1)
Z = UnitZ(Factor=Slider(59, range=0..100))
line = LineSDL(Start=pt, Direction=Y, Length=Slider(1000, range=0..1000))
dom = ConstructDomain(DomainStart=Slider(0, range=0..1), DomainEnd=Slider(1, range=0..1))
range = Range(Domain=dom, Steps=Slider(16, range=0..100))
move = Move(Geometry=line, Motion=Z)  # -> Geometry, Transform
multiplication = Multiplication(A=graph, B=Slider(100, range=0..100))
eval = EvaluateCurve(Curve=move.Geometry, Parameter=range)  # -> Point, Tangent, Angle
Z_2 = UnitZ(Factor=multiplication)
neg = Negative(Value=Z_2)
move_2 = Move(Geometry=eval.Point, Motion=neg)  # -> Geometry, Transform
intcrv_t = InterpolateT(Vertices=move_2.Geometry, TangentStart=Vector(0, 0, 0), TangentEnd=Vector(0, 0, 0), KnotStyle=1)  # -> Curve, Length, Domain

# ----
series_2 = Series(Start=Slider(0, range=0..100), Step=Slider(0.15, range=0..1), Count=Slider(10, range=0..100))
pt_2 = ConstructPoint(XCoordinate=0, YCoordinate=0, ZCoordinate=0)
graph_2 = GraphMapper(series_2, x0=0, x1=1.5, y0=0, y1=1, container_name="Sine", Equation_px=[0, 1], Equation_py=[0, 1])
cir = Circle(Plane=pt_2, Radius=Slider(100, range=0..1000))
cir_2 = Circle(Plane=pt_2, Radius=Slider(10, range=0..1000))

number_slider_5 = Slider(3, range=0..10)
dom_2 = ConstructDomain(DomainStart=Slider(0, range=0..1), DomainEnd=Slider(0.125, range=0..1))
Z_3 = UnitZ(Factor=number_slider_5)
pt_3 = ConstructPoint(XCoordinate=0, YCoordinate=0, ZCoordinate=number_slider_5)
move_3 = Move(Geometry=cir, Motion=Z_3)  # -> Geometry, Transform
range_2 = Range(Domain=dom_2, Steps=Slider(14, range=0..100))
eval_2 = EvaluateCurve(Curve=reparameterize(move_3.Geometry), Parameter=range_2)  # -> Point, Tangent, Angle
intcrv = Interpolate(Vertices=eval_2.Point, Degree=3, Periodic=False, KnotStyle=1)  # -> Curve, Length, Domain
neg_2 = Negative(Value=number_slider_5)
dispatch = Dispatch(List=eval_2.Point, DispatchPattern=[True, False])  # -> ListA, ListB
Z_4 = UnitZ(Factor=neg_2)
move_4 = Move(Geometry=dispatch.ListA, Motion=Z_4)  # -> Geometry, Transform
range_3 = Range(Domain=Slider(1, range=0..1), Steps=Slider(8, range=0..100))
scale = Scale(Geometry=intcrv.Curve, Center=pt_3, Factor=Slider(0.95, range=0..1))  # -> Geometry, Transform
scale_2 = Scale(Geometry=scale.Geometry, Center=pt_3, Factor=Slider(0.97, range=0..1))  # -> Geometry, Transform
curvepoint = PointOnCurve(scale_2.Geometry, parameter=0)
dist = Distance(PointA=pt_3, PointB=curvepoint)
weave = Weave(Pattern=[0, 1], Stream0=move_4.Geometry, Stream1=dispatch.ListB, NullGaps=False)
range_4 = Range(Domain=Domain(0, 1), Steps=10)
Z_5 = UnitZ(Factor=Slider(0.15, range=0..1))
intcrv_2 = Interpolate(Vertices=weave, Degree=3, Periodic=False, KnotStyle=1)  # -> Curve, Length, Domain
md_slider = MDSlider(
    SliderMode=0,
    slider_value=Point(0.5024384289, 0.4989832436, 0.5),
    x_domain=Domain(0, 1),
    y_domain=Domain(0, 1),
    z_domain=Domain(0, 1))
tweencrv = TweenCurve(CurveA=scale.Geometry, CurveB=intcrv_2.Curve, Factor=range_4, BlendType=0)
neg_3 = Negative(Value=Z_5)
curvepoint_2 = PointOnCurve(tweencrv, parameter=0)
lng = ListLength(List=weave)
extr = Extrude(Base=tweencrv, Direction=neg_3)
number_slider_6 = Slider(10, range=0..10)
loft = Loft(Curves=tweencrv, Options={Adjust=False, Closed=False, LoftEnds=0, LoftSimp=0, LoftType=0, Rebuild=10, Refit=0.01})
cull_i = CullIndex(List=weave, Indices=lng, Wrap=True)
evalsrf = EvaluateSurface(Surface=reparameterize(extr), Point=md_slider)  # -> Point, Normal, UDirection, VDirection, Frame
srfsplit = SurfaceSplit(Surface=loft, Curves=tweencrv)
offcrv = OffsetCurve(Curve=tweencrv, Plane=PlaneXY(0, 0, 0), Distance=Slider(0.5, range=0..1), BothSides=0, Kinks=0, CapType=1)
pline = PolyLine(Vertices=cull_i, Closed=True)
neg_4 = Negative(Value=Slider(0.5, range=0..1))
points = PointList(Points=cull_i, Size=Slider(0.4, range=0..1))
line_2 = LineSDL(Start=evalsrf.Point, Direction=evalsrf.Normal, Length=neg_4)
extrcrv = ExtrudeAlong(Base=tweencrv, Curve=line_2)  # -> graft(Extrusion)
neg_5 = Negative(Value=Slider(0.3, range=0..1))
divide = DivideDomain²(Domain=extrcrv, UCount=Slider(150, range=0..1000), VCount=Slider(1, range=0..10))
sbox = SurfaceBox(Surface=extrcrv, Domain=divide, Height=neg_5)  # -> graft(TwistedBox)
subsrf = Isotrim(Surface=extrcrv, Domain=divide)

multiplication_2 = Multiplication(A=graph_2, B=Slider(43, range=0..100))
X = UnitX(Factor=multiplication_2)
pt_4 = ConstructPoint(XCoordinate=0, YCoordinate=0, ZCoordinate=Slider(3, range=0..10))
move_5 = Move(Geometry=move_2.Geometry, Motion=X)  # -> Geometry, Transform
intcrv_t_2 = InterpolateT(Vertices=move_5.Geometry, TangentStart=Vector(0, 0, 0), TangentEnd=Vector(0, 0, 0), KnotStyle=1)  # -> Curve, Length, Domain
cir_3 = Circle(Plane=pt_4, Radius=dist)

number_slider_7 = Slider(3, range=0..10)
dom_3 = ConstructDomain(DomainStart=Slider(0, range=0..1), DomainEnd=Slider(0.125, range=0..1))
Z_6 = UnitZ(Factor=number_slider_7)
move_6 = Move(Geometry=cir_3, Motion=Z_6)  # -> Geometry, Transform
range_5 = Range(Domain=dom_3, Steps=Slider(14, range=0..100))
eval_3 = EvaluateCurve(Curve=reparameterize(move_6.Geometry), Parameter=range_5)  # -> Point, Tangent, Angle
intcrv_3 = Interpolate(Vertices=eval_3.Point, Degree=3, Periodic=False, KnotStyle=1)  # -> Curve, Length, Domain
pt_5 = ConstructPoint(XCoordinate=0, YCoordinate=0, ZCoordinate=number_slider_7)
neg_6 = Negative(Value=number_slider_7)
dispatch_2 = Dispatch(List=eval_3.Point, DispatchPattern=[True, False])  # -> ListA, ListB
Z_7 = UnitZ(Factor=neg_6)
move_7 = Move(Geometry=dispatch_2.ListA, Motion=Z_7)  # -> Geometry, Transform
range_6 = Range(Domain=Slider(1, range=0..1), Steps=Slider(8, range=0..100))
scale_3 = Scale(Geometry=intcrv_3.Curve, Center=pt_5, Factor=Slider(0.95, range=0..1))  # -> Geometry, Transform
scale_4 = Scale(Geometry=scale_3.Geometry, Center=pt_5, Factor=Slider(0.97, range=0..1))  # -> Geometry, Transform
curvepoint_3 = PointOnCurve(scale_4.Geometry, parameter=0)
dist_2 = Distance(PointA=pt_5, PointB=curvepoint_3)
weave_2 = Weave(Pattern=[0, 1], Stream0=move_7.Geometry, Stream1=dispatch_2.ListB, NullGaps=False)
range_7 = Range(Domain=Domain(0, 1), Steps=10)
Z_8 = UnitZ(Factor=Slider(0.15, range=0..1))
intcrv_4 = Interpolate(Vertices=weave_2, Degree=3, Periodic=False, KnotStyle=1)  # -> Curve, Length, Domain
md_slider_2 = MDSlider(
    SliderMode=0,
    slider_value=Point(0.5024384289, 0.4989832436, 0.5),
    x_domain=Domain(0, 1),
    y_domain=Domain(0, 1),
    z_domain=Domain(0, 1))
tweencrv_2 = TweenCurve(CurveA=scale_3.Geometry, CurveB=intcrv_4.Curve, Factor=range_7, BlendType=0)
neg_7 = Negative(Value=Z_8)
curvepoint_4 = PointOnCurve(tweencrv_2, parameter=0)
lng_2 = ListLength(List=weave_2)
extr_2 = Extrude(Base=tweencrv_2, Direction=neg_7)
number_slider_8 = Slider(10, range=0..10)
loft_2 = Loft(Curves=tweencrv_2, Options={Adjust=False, Closed=False, LoftEnds=0, LoftSimp=0, LoftType=0, Rebuild=10, Refit=0.01})
cull_i_2 = CullIndex(List=weave_2, Indices=lng_2, Wrap=True)
evalsrf_2 = EvaluateSurface(Surface=reparameterize(extr_2), Point=md_slider_2)  # -> Point, Normal, UDirection, VDirection, Frame
srfsplit_2 = SurfaceSplit(Surface=loft_2, Curves=tweencrv_2)
offcrv_2 = OffsetCurve(Curve=tweencrv_2, Plane=PlaneXY(0, 0, 0), Distance=Slider(0.5, range=0..1), BothSides=0, Kinks=0, CapType=1)
pline_2 = PolyLine(Vertices=cull_i_2, Closed=True)
neg_8 = Negative(Value=Slider(0.5, range=0..1))
points_2 = PointList(Points=cull_i_2, Size=Slider(0.4, range=0..1))
line_3 = LineSDL(Start=evalsrf_2.Point, Direction=evalsrf_2.Normal, Length=neg_8)
extrcrv_2 = ExtrudeAlong(Base=tweencrv_2, Curve=line_3)  # -> graft(Extrusion)
neg_9 = Negative(Value=Slider(0.3, range=0..1))
divide_2 = DivideDomain²(Domain=extrcrv_2, UCount=Slider(150, range=0..1000), VCount=Slider(1, range=0..10))
sbox_2 = SurfaceBox(Surface=extrcrv_2, Domain=divide_2, Height=neg_9)
subsrf_2 = Isotrim(Surface=extrcrv_2, Domain=divide_2)

crv = Curve(move.Geometry)
crv_2 = Curve(intcrv_t.Curve)
X_2 = UnitX(Factor=Slider(73, range=0..100))
move_8 = Move(Geometry=crv_2, Motion=X_2)  # -> Geometry, Transform
range_8 = Range(Domain=Slider(1, range=0..1), Steps=Slider(8, range=0..100))
tweencrv_3 = TweenCurve(CurveA=crv, CurveB=move_8.Geometry, Factor=range_8, BlendType=0)
flip = FlipMatrix(Data=tweencrv_3)
Z_9 = UnitZ(Factor=Slider(6, range=0..10))
loft_3 = Loft(Curves=tweencrv_3, Options={Adjust=False, Closed=False, LoftEnds=0, LoftSimp=0, LoftType=0, Rebuild=10, Refit=0.01})
pt_6 = ConstructPoint(XCoordinate=0, YCoordinate=0, ZCoordinate=Slider(6, range=0..10))
X_3 = UnitX(Factor=Slider(10, range=0..10))
move_9 = Move(Geometry=tweencrv_3, Motion=Z_9)  # -> Geometry, Transform
flip_2 = FlipMatrix(Data=move_9.Geometry)
Z_10 = UnitZ(Factor=Slider(25, range=0..100))
extr_3 = Extrude(Base=tweencrv_3, Direction=X_3)
neg_10 = Negative(Value=Z_10)
move_10 = Move(Geometry=extr_3, Motion=neg_10)  # -> Geometry, Transform
loft_4 = Loft(Curves=[flip, flip_2], Options={Adjust=False, Closed=False, LoftEnds=0, LoftSimp=0, LoftType=0, Rebuild=10, Refit=0.01})
number_slider_9 = Slider(10, range=0..10)
srfsplit_3 = SurfaceSplit(Surface=loft_3, Curves=tweencrv_3)
number_slider_10 = Slider(10, range=0..10)
cir_4 = Circle(Plane=pt_6, Radius=dist_2)

number_slider_11 = Slider(3, range=0..10)
dom_4 = ConstructDomain(DomainStart=Slider(0, range=0..1), DomainEnd=Slider(0.125, range=0..1))
Z_11 = UnitZ(Factor=number_slider_11)
move_11 = Move(Geometry=cir_4, Motion=Z_11)  # -> Geometry, Transform
range_9 = Range(Domain=dom_4, Steps=Slider(14, range=0..100))
pt_7 = ConstructPoint(XCoordinate=0, YCoordinate=0, ZCoordinate=number_slider_11)
eval_4 = EvaluateCurve(Curve=reparameterize(move_11.Geometry), Parameter=range_9)  # -> Point, Tangent, Angle
intcrv_5 = Interpolate(Vertices=eval_4.Point, Degree=3, Periodic=False, KnotStyle=1)  # -> Curve, Length, Domain
neg_11 = Negative(Value=number_slider_11)
dispatch_3 = Dispatch(List=eval_4.Point, DispatchPattern=[True, False])  # -> ListA, ListB
Z_12 = UnitZ(Factor=neg_11)
move_12 = Move(Geometry=dispatch_3.ListA, Motion=Z_12)  # -> Geometry, Transform
range_10 = Range(Domain=Slider(1, range=0..1), Steps=Slider(8, range=0..100))
scale_5 = Scale(Geometry=intcrv_5.Curve, Center=pt_7, Factor=Slider(0.95, range=0..1))  # -> Geometry, Transform
scale_6 = Scale(Geometry=scale_5.Geometry, Center=pt_7, Factor=Slider(0.97, range=0..1))  # -> Geometry, Transform
curvepoint_5 = PointOnCurve(scale_6.Geometry, parameter=0)
dist_3 = Distance(PointA=pt_7, PointB=curvepoint_5)
weave_3 = Weave(Pattern=[0, 1], Stream0=move_12.Geometry, Stream1=dispatch_3.ListB, NullGaps=False)
range_11 = Range(Domain=Domain(0, 1), Steps=10)
Z_13 = UnitZ(Factor=Slider(0.15, range=0..1))
intcrv_6 = Interpolate(Vertices=weave_3, Degree=3, Periodic=False, KnotStyle=1)  # -> Curve, Length, Domain
md_slider_3 = MDSlider(
    SliderMode=0,
    slider_value=Point(0.5024384289, 0.4989832436, 0.5),
    x_domain=Domain(0, 1),
    y_domain=Domain(0, 1),
    z_domain=Domain(0, 1))
tweencrv_4 = TweenCurve(CurveA=scale_5.Geometry, CurveB=intcrv_6.Curve, Factor=range_11, BlendType=0)
neg_12 = Negative(Value=Z_13)
curvepoint_6 = PointOnCurve(tweencrv_4, parameter=0)
lng_3 = ListLength(List=weave_3)
extr_4 = Extrude(Base=tweencrv_4, Direction=neg_12)
number_slider_12 = Slider(10, range=0..10)
loft_5 = Loft(Curves=tweencrv_4, Options={Adjust=False, Closed=False, LoftEnds=0, LoftSimp=0, LoftType=0, Rebuild=10, Refit=0.01})
cull_i_3 = CullIndex(List=weave_3, Indices=lng_3, Wrap=True)
evalsrf_3 = EvaluateSurface(Surface=reparameterize(extr_4), Point=md_slider_3)  # -> Point, Normal, UDirection, VDirection, Frame
srfsplit_4 = SurfaceSplit(Surface=loft_5, Curves=tweencrv_4)
offcrv_3 = OffsetCurve(Curve=tweencrv_4, Plane=PlaneXY(0, 0, 0), Distance=Slider(0.5, range=0..1), BothSides=0, Kinks=0, CapType=1)
pline_3 = PolyLine(Vertices=cull_i_3, Closed=True)
neg_13 = Negative(Value=Slider(0.5, range=0..1))
points_3 = PointList(Points=cull_i_3, Size=Slider(0.4, range=0..1))
line_4 = LineSDL(Start=evalsrf_3.Point, Direction=evalsrf_3.Normal, Length=neg_13)
extrcrv_3 = ExtrudeAlong(Base=tweencrv_4, Curve=line_4)  # -> graft(Extrusion)
neg_14 = Negative(Value=Slider(0.3, range=0..1))
divide_3 = DivideDomain²(Domain=extrcrv_3, UCount=Slider(150, range=0..1000), VCount=Slider(1, range=0..10))
sbox_3 = SurfaceBox(Surface=extrcrv_3, Domain=divide_3, Height=neg_14)
subsrf_3 = Isotrim(Surface=extrcrv_3, Domain=divide_3)

number_slider_13 = Slider(23, range=0..100)
X_4 = UnitX(Factor=Slider(9, range=5..250))
extr_5 = Extrude(Base=loft_4, Direction=X_4)
offset = OffsetSurface(Surface=move_10.Geometry, Distance=number_slider_13, Retrim=True)
pt_8 = ConstructPoint(XCoordinate=0, YCoordinate=0, ZCoordinate=Slider(9, range=0..10))
panel = Panel(offset)
divide_4 = DivideDomain²(Domain=offset, UCount=Slider(1, range=0..10), VCount=Slider(38, range=0..100))
cir_5 = Circle(Plane=pt_8, Radius=dist_3)

number_slider_14 = Slider(3, range=0..10)
dom_5 = ConstructDomain(DomainStart=Slider(0, range=0..1), DomainEnd=Slider(0.125, range=0..1))
Z_14 = UnitZ(Factor=number_slider_14)
move_13 = Move(Geometry=cir_5, Motion=Z_14)  # -> Geometry, Transform
range_12 = Range(Domain=dom_5, Steps=Slider(14, range=0..100))
pt_9 = ConstructPoint(XCoordinate=0, YCoordinate=0, ZCoordinate=number_slider_14)
eval_5 = EvaluateCurve(Curve=reparameterize(move_13.Geometry), Parameter=range_12)  # -> Point, Tangent, Angle
intcrv_7 = Interpolate(Vertices=eval_5.Point, Degree=3, Periodic=False, KnotStyle=1)  # -> Curve, Length, Domain
neg_15 = Negative(Value=number_slider_14)
dispatch_4 = Dispatch(List=eval_5.Point, DispatchPattern=[True, False])  # -> ListA, ListB
Z_15 = UnitZ(Factor=neg_15)
move_14 = Move(Geometry=dispatch_4.ListA, Motion=Z_15)  # -> Geometry, Transform
range_13 = Range(Domain=Slider(1, range=0..1), Steps=Slider(8, range=0..100))
scale_7 = Scale(Geometry=intcrv_7.Curve, Center=pt_9, Factor=Slider(0.95, range=0..1))  # -> Geometry, Transform
scale_8 = Scale(Geometry=scale_7.Geometry, Center=pt_9, Factor=Slider(0.97, range=0..1))  # -> Geometry, Transform
curvepoint_7 = PointOnCurve(scale_8.Geometry, parameter=0)
dist_4 = Distance(PointA=pt_9, PointB=curvepoint_7)
weave_4 = Weave(Pattern=[0, 1], Stream0=move_14.Geometry, Stream1=dispatch_4.ListB, NullGaps=False)
range_14 = Range(Domain=Domain(0, 1), Steps=10)
Z_16 = UnitZ(Factor=Slider(0.15, range=0..1))
intcrv_8 = Interpolate(Vertices=weave_4, Degree=3, Periodic=False, KnotStyle=1)  # -> Curve, Length, Domain
md_slider_4 = MDSlider(
    SliderMode=0,
    slider_value=Point(0.5024384289, 0.4989832436, 0.5),
    x_domain=Domain(0, 1),
    y_domain=Domain(0, 1),
    z_domain=Domain(0, 1))
tweencrv_5 = TweenCurve(CurveA=scale_7.Geometry, CurveB=intcrv_8.Curve, Factor=range_14, BlendType=0)
neg_16 = Negative(Value=Z_16)
curvepoint_8 = PointOnCurve(tweencrv_5, parameter=0)
lng_4 = ListLength(List=weave_4)
extr_6 = Extrude(Base=tweencrv_5, Direction=neg_16)
number_slider_15 = Slider(10, range=0..10)
loft_6 = Loft(Curves=tweencrv_5, Options={Adjust=False, Closed=False, LoftEnds=0, LoftSimp=0, LoftType=0, Rebuild=10, Refit=0.01})
cull_i_4 = CullIndex(List=weave_4, Indices=lng_4, Wrap=True)
evalsrf_4 = EvaluateSurface(Surface=reparameterize(extr_6), Point=md_slider_4)  # -> Point, Normal, UDirection, VDirection, Frame
srfsplit_5 = SurfaceSplit(Surface=loft_6, Curves=tweencrv_5)
offcrv_4 = OffsetCurve(Curve=tweencrv_5, Plane=PlaneXY(0, 0, 0), Distance=Slider(0.5, range=0..1), BothSides=0, Kinks=0, CapType=1)
pline_4 = PolyLine(Vertices=cull_i_4, Closed=True)
neg_17 = Negative(Value=Slider(0.5, range=0..1))
points_4 = PointList(Points=cull_i_4, Size=Slider(0.4, range=0..1))
line_5 = LineSDL(Start=evalsrf_4.Point, Direction=evalsrf_4.Normal, Length=neg_17)
extrcrv_4 = ExtrudeAlong(Base=tweencrv_5, Curve=line_5)  # -> graft(Extrusion)
neg_18 = Negative(Value=Slider(0.3, range=0..1))
divide_5 = DivideDomain²(Domain=extrcrv_4, UCount=Slider(150, range=0..1000), VCount=Slider(1, range=0..10))
sbox_4 = SurfaceBox(Surface=extrcrv_4, Domain=divide_5, Height=neg_18)
subsrf_4 = Isotrim(Surface=extrcrv_4, Domain=divide_5)

mesh = Mesh(<mesh referenced from the Rhino model>)
sbox_5 = SurfaceBox(Surface=graft(offset), Domain=divide_4, Height=number_slider_13)
bbox = BoundingBox(Content=mesh, Plane=PlaneXY(0, 0, 0))  # -> Box, Box_2
morph = BoxMorph(Geometry=mesh, Reference=bbox.Box, Target=sbox_5)
pt_10 = ConstructPoint(XCoordinate=0, YCoordinate=0, ZCoordinate=Slider(12, range=0..100))
mesh_2 = Mesh([<mesh referenced from the Rhino model> x8])
Z_17 = UnitZ(Factor=Slider(0.05, range=0..0.1))
extr_7 = Extrude(Base=extrcrv, Direction=Z_17)
bbox_2 = BoundingBox(Content=mesh_2, Plane=PlaneXY(0, 0, 0), UnionBox=True)  # -> Box, Box_2
cir_6 = Circle(Plane=pt_10, Radius=dist_4)

number_slider_16 = Slider(3, range=0..10)
dom_6 = ConstructDomain(DomainStart=Slider(0, range=0..1), DomainEnd=Slider(0.125, range=0..1))
Z_18 = UnitZ(Factor=number_slider_16)
move_15 = Move(Geometry=cir_6, Motion=Z_18)  # -> Geometry, Transform
range_15 = Range(Domain=dom_6, Steps=Slider(14, range=0..100))
pt_11 = ConstructPoint(XCoordinate=0, YCoordinate=0, ZCoordinate=number_slider_16)
eval_6 = EvaluateCurve(Curve=reparameterize(move_15.Geometry), Parameter=range_15)  # -> Point, Tangent, Angle
intcrv_9 = Interpolate(Vertices=eval_6.Point, Degree=3, Periodic=False, KnotStyle=1)  # -> Curve, Length, Domain
neg_19 = Negative(Value=number_slider_16)
dispatch_5 = Dispatch(List=eval_6.Point, DispatchPattern=[True, False])  # -> ListA, ListB
Z_19 = UnitZ(Factor=neg_19)
move_16 = Move(Geometry=dispatch_5.ListA, Motion=Z_19)  # -> Geometry, Transform
range_16 = Range(Domain=Slider(1, range=0..1), Steps=Slider(8, range=0..100))
scale_9 = Scale(Geometry=intcrv_9.Curve, Center=pt_11, Factor=Slider(0.95, range=0..1))  # -> Geometry, Transform
scale_10 = Scale(Geometry=scale_9.Geometry, Center=pt_11, Factor=Slider(0.97, range=0..1))  # -> Geometry, Transform
curvepoint_9 = PointOnCurve(scale_10.Geometry, parameter=0)
dist_5 = Distance(PointA=pt_11, PointB=curvepoint_9)
weave_5 = Weave(Pattern=[0, 1], Stream0=move_16.Geometry, Stream1=dispatch_5.ListB, NullGaps=False)
range_17 = Range(Domain=Domain(0, 1), Steps=10)
Z_20 = UnitZ(Factor=Slider(0.15, range=0..1))
intcrv_10 = Interpolate(Vertices=weave_5, Degree=3, Periodic=False, KnotStyle=1)  # -> Curve, Length, Domain
md_slider_5 = MDSlider(
    SliderMode=0,
    slider_value=Point(0.5024384289, 0.4989832436, 0.5),
    x_domain=Domain(0, 1),
    y_domain=Domain(0, 1),
    z_domain=Domain(0, 1))
tweencrv_6 = TweenCurve(CurveA=scale_9.Geometry, CurveB=intcrv_10.Curve, Factor=range_17, BlendType=0)
neg_20 = Negative(Value=Z_20)
curvepoint_10 = PointOnCurve(tweencrv_6, parameter=0)
lng_5 = ListLength(List=weave_5)
extr_8 = Extrude(Base=tweencrv_6, Direction=neg_20)
number_slider_17 = Slider(10, range=0..10)
loft_7 = Loft(Curves=tweencrv_6, Options={Adjust=False, Closed=False, LoftEnds=0, LoftSimp=0, LoftType=0, Rebuild=10, Refit=0.01})
cull_i_5 = CullIndex(List=weave_5, Indices=lng_5, Wrap=True)
evalsrf_5 = EvaluateSurface(Surface=reparameterize(extr_8), Point=md_slider_5)  # -> Point, Normal, UDirection, VDirection, Frame
srfsplit_6 = SurfaceSplit(Surface=loft_7, Curves=tweencrv_6)
offcrv_5 = OffsetCurve(Curve=tweencrv_6, Plane=PlaneXY(0, 0, 0), Distance=Slider(0.5, range=0..1), BothSides=0, Kinks=0, CapType=1)
pline_5 = PolyLine(Vertices=cull_i_5, Closed=True)
neg_21 = Negative(Value=Slider(0.5, range=0..1))
points_5 = PointList(Points=cull_i_5, Size=Slider(0.4, range=0..1))
line_6 = LineSDL(Start=evalsrf_5.Point, Direction=evalsrf_5.Normal, Length=neg_21)
extrcrv_5 = ExtrudeAlong(Base=tweencrv_6, Curve=line_6)  # -> graft(Extrusion)
neg_22 = Negative(Value=Slider(0.3, range=0..1))
divide_6 = DivideDomain²(Domain=extrcrv_5, UCount=Slider(150, range=0..1000), VCount=Slider(1, range=0..10))
sbox_6 = SurfaceBox(Surface=extrcrv_5, Domain=divide_6, Height=neg_22)
subsrf_5 = Isotrim(Surface=extrcrv_5, Domain=divide_6)

morph_2 = BoxMorph(Geometry=mesh_2, Reference=bbox_2.Box, Target=sbox)
neg_23 = Negative(Value=Slider(0.3, range=0..1))
Z_21 = UnitZ(Factor=neg_23)
move_17 = Move(Geometry=extr_7, Motion=Z_21)  # -> Geometry, Transform
geo = Geometry([morph_2, move_17.Geometry, extr_7])
divide_7 = DivideCurve(Curve=cir, Count=Slider(8, range=0..10), Kinks=False)  # -> Points, Tangents, Parameters
pt_12 = ConstructPoint(XCoordinate=0, YCoordinate=0, ZCoordinate=Slider(15, range=0..100))
cir_7 = Circle(Plane=pt_12, Radius=dist_5)

number_slider_18 = Slider(3, range=0..10)
dom_7 = ConstructDomain(DomainStart=Slider(0, range=0..1), DomainEnd=Slider(0.125, range=0..1))
Z_22 = UnitZ(Factor=number_slider_18)
move_18 = Move(Geometry=cir_7, Motion=Z_22)  # -> Geometry, Transform
range_18 = Range(Domain=dom_7, Steps=Slider(14, range=0..100))
pt_13 = ConstructPoint(XCoordinate=0, YCoordinate=0, ZCoordinate=number_slider_18)
eval_7 = EvaluateCurve(Curve=reparameterize(move_18.Geometry), Parameter=range_18)  # -> Point, Tangent, Angle
intcrv_11 = Interpolate(Vertices=eval_7.Point, Degree=3, Periodic=False, KnotStyle=1)  # -> Curve, Length, Domain
neg_24 = Negative(Value=number_slider_18)
dispatch_6 = Dispatch(List=eval_7.Point, DispatchPattern=[True, False])  # -> ListA, ListB
Z_23 = UnitZ(Factor=neg_24)
move_19 = Move(Geometry=dispatch_6.ListA, Motion=Z_23)  # -> Geometry, Transform
range_19 = Range(Domain=Slider(1, range=0..1), Steps=Slider(8, range=0..100))
scale_11 = Scale(Geometry=intcrv_11.Curve, Center=pt_13, Factor=Slider(0.95, range=0..1))  # -> Geometry, Transform
scale_12 = Scale(Geometry=scale_11.Geometry, Center=pt_13, Factor=Slider(0.97, range=0..1))  # -> Geometry, Transform
curvepoint_11 = PointOnCurve(scale_12.Geometry, parameter=0)
dist_6 = Distance(PointA=pt_13, PointB=curvepoint_11)
weave_6 = Weave(Pattern=[0, 1], Stream0=move_19.Geometry, Stream1=dispatch_6.ListB, NullGaps=False)
range_20 = Range(Domain=Domain(0, 1), Steps=10)
Z_24 = UnitZ(Factor=Slider(0.15, range=0..1))
intcrv_12 = Interpolate(Vertices=weave_6, Degree=3, Periodic=False, KnotStyle=1)  # -> Curve, Length, Domain
md_slider_6 = MDSlider(
    SliderMode=0,
    slider_value=Point(0.5024384289, 0.4989832436, 0.5),
    x_domain=Domain(0, 1),
    y_domain=Domain(0, 1),
    z_domain=Domain(0, 1))
tweencrv_7 = TweenCurve(CurveA=scale_11.Geometry, CurveB=intcrv_12.Curve, Factor=range_20, BlendType=0)
neg_25 = Negative(Value=Z_24)
curvepoint_12 = PointOnCurve(tweencrv_7, parameter=0)
lng_6 = ListLength(List=weave_6)
extr_9 = Extrude(Base=tweencrv_7, Direction=neg_25)
number_slider_19 = Slider(10, range=0..10)
loft_8 = Loft(Curves=tweencrv_7, Options={Adjust=False, Closed=False, LoftEnds=0, LoftSimp=0, LoftType=0, Rebuild=10, Refit=0.01})
cull_i_6 = CullIndex(List=weave_6, Indices=lng_6, Wrap=True)
evalsrf_6 = EvaluateSurface(Surface=reparameterize(extr_9), Point=md_slider_6)  # -> Point, Normal, UDirection, VDirection, Frame
srfsplit_7 = SurfaceSplit(Surface=loft_8, Curves=tweencrv_7)
offcrv_6 = OffsetCurve(Curve=tweencrv_7, Plane=PlaneXY(0, 0, 0), Distance=Slider(0.5, range=0..1), BothSides=0, Kinks=0, CapType=1)
pline_6 = PolyLine(Vertices=cull_i_6, Closed=True)
neg_26 = Negative(Value=Slider(0.5, range=0..1))
points_6 = PointList(Points=cull_i_6, Size=Slider(0.4, range=0..1))
line_7 = LineSDL(Start=evalsrf_6.Point, Direction=evalsrf_6.Normal, Length=neg_26)
extrcrv_6 = ExtrudeAlong(Base=tweencrv_7, Curve=line_7)  # -> graft(Extrusion)
neg_27 = Negative(Value=Slider(0.3, range=0..1))
divide_8 = DivideDomain²(Domain=extrcrv_6, UCount=Slider(125, range=0..1000), VCount=Slider(1, range=0..10))
sbox_7 = SurfaceBox(Surface=extrcrv_6, Domain=divide_8, Height=neg_27)
subsrf_6 = Isotrim(Surface=extrcrv_6, Domain=divide_8)
