# Grasshopper definition assignment 1 outer code.gh (Grasshopper 1.0.7)
# plug-ins: Pufferfish

pt = ConstructPoint(XCoordinate=0, YCoordinate=0, ZCoordinate=0)
cir = Circle(Plane=pt, Radius=Slider(100, range=0..1000))
cir_2 = Circle(Plane=pt, Radius=Slider(10, range=0..1000))
Z = UnitZ(Factor=Slider(0.3, range=0..1))
srf = Surface(cir)
extr = Extrude(Base=srf, Direction=Z)

number_slider = Slider(3, range=0..10)
dom = ConstructDomain(DomainStart=Slider(0, range=0..1), DomainEnd=Slider(1, range=0..1))
Z_2 = UnitZ(Factor=number_slider)
move = Move(Geometry=cir, Motion=Z_2)  # -> Geometry, Transform
range = Range(Domain=dom, Steps=Slider(100, range=0..100))
pt_2 = ConstructPoint(XCoordinate=0, YCoordinate=0, ZCoordinate=Slider(4.5, range=0..10))
eval = EvaluateCurve(Curve=reparameterize(move.Geometry), Parameter=range)  # -> Point, Tangent, Angle
intcrv = Interpolate(Vertices=eval.Point, Degree=3, Periodic=False, KnotStyle=1)  # -> Curve, Length, Domain
neg = Negative(Value=number_slider)
dispatch = Dispatch(List=eval.Point, DispatchPattern=[True, False])  # -> ListA, ListB
Z_3 = UnitZ(Factor=neg)
scale = Scale(Geometry=intcrv.Curve, Center=pt_2, Factor=Slider(0.9, range=0..1))  # -> Geometry, Transform
scale_2 = Scale(Geometry=scale.Geometry, Center=pt_2, Factor=Slider(0.95, range=0..1))  # -> Geometry, Transform
move_2 = Move(Geometry=dispatch.ListA, Motion=Z_3)  # -> Geometry, Transform
range_2 = Range(Domain=Slider(1, range=0..1), Steps=Slider(8, range=0..100))
weave = Weave(Pattern=[0, 1], Stream0=move_2.Geometry, Stream1=dispatch.ListB, NullGaps=False)
intcrv_2 = Interpolate(Vertices=weave, Degree=3, Periodic=False, KnotStyle=1)  # -> Curve, Length, Domain
range_3 = Range(Domain=Domain(0, 1), Steps=Slider(15, range=0..100))
tweencrv = TweenCurve(CurveA=scale.Geometry, CurveB=intcrv_2.Curve, Factor=range_3, BlendType=0)

number_slider_2 = Slider(3, range=0..10)
dom_2 = ConstructDomain(DomainStart=Slider(0, range=0..1), DomainEnd=Slider(1, range=0..1))
Z_4 = UnitZ(Factor=number_slider_2)
pt_3 = ConstructPoint(XCoordinate=0, YCoordinate=0, ZCoordinate=Slider(9, range=0..10))
move_3 = Move(Geometry=scale_2.Geometry, Motion=Z_4)  # -> Geometry, Transform
range_4 = Range(Domain=dom_2, Steps=Slider(100, range=0..100))
eval_2 = EvaluateCurve(Curve=reparameterize(move_3.Geometry), Parameter=range_4)  # -> Point, Tangent, Angle
intcrv_3 = Interpolate(Vertices=eval_2.Point, Degree=3, Periodic=False, KnotStyle=1)  # -> Curve, Length, Domain
neg_2 = Negative(Value=number_slider_2)
dispatch_2 = Dispatch(List=eval_2.Point, DispatchPattern=[True, False])  # -> ListA, ListB
Z_5 = UnitZ(Factor=neg_2)
move_4 = Move(Geometry=dispatch_2.ListA, Motion=Z_5)  # -> Geometry, Transform
range_5 = Range(Domain=Slider(1, range=0..1), Steps=Slider(8, range=0..100))
scale_3 = Scale(Geometry=intcrv_3.Curve, Center=pt_3, Factor=Slider(0.9, range=0..1))  # -> Geometry, Transform
scale_4 = Scale(Geometry=scale_3.Geometry, Center=pt_3, Factor=Slider(0.94, range=0..1))  # -> Geometry, Transform
weave_2 = Weave(Pattern=[0, 1], Stream0=move_4.Geometry, Stream1=dispatch_2.ListB, NullGaps=False)
range_6 = Range(Domain=Domain(0, 1), Steps=Slider(15, range=0..100))
intcrv_4 = Interpolate(Vertices=weave_2, Degree=3, Periodic=False, KnotStyle=1)  # -> Curve, Length, Domain
tweencrv_2 = TweenCurve(CurveA=scale_3.Geometry, CurveB=intcrv_4.Curve, Factor=range_6, BlendType=0)

number_slider_3 = Slider(3, range=0..10)
dom_3 = ConstructDomain(DomainStart=Slider(0, range=0..1), DomainEnd=Slider(1, range=0..1))
Z_6 = UnitZ(Factor=number_slider_3)
pt_4 = ConstructPoint(XCoordinate=0, YCoordinate=0, ZCoordinate=Slider(13.5, range=0..100))
move_5 = Move(Geometry=scale_4.Geometry, Motion=Z_6)  # -> Geometry, Transform
range_7 = Range(Domain=dom_3, Steps=Slider(100, range=0..100))
eval_3 = EvaluateCurve(Curve=reparameterize(move_5.Geometry), Parameter=range_7)  # -> Point, Tangent, Angle
intcrv_5 = Interpolate(Vertices=eval_3.Point, Degree=3, Periodic=False, KnotStyle=1)  # -> Curve, Length, Domain
neg_3 = Negative(Value=number_slider_3)
dispatch_3 = Dispatch(List=eval_3.Point, DispatchPattern=[True, False])  # -> ListA, ListB
Z_7 = UnitZ(Factor=neg_3)
move_6 = Move(Geometry=dispatch_3.ListA, Motion=Z_7)  # -> Geometry, Transform
range_8 = Range(Domain=Slider(1, range=0..1), Steps=Slider(8, range=0..100))
scale_5 = Scale(Geometry=intcrv_5.Curve, Center=pt_4, Factor=Slider(0.9, range=0..1))  # -> Geometry, Transform
scale_6 = Scale(Geometry=scale_5.Geometry, Center=pt_4, Factor=Slider(0.93, range=0..1))  # -> Geometry, Transform
weave_3 = Weave(Pattern=[0, 1], Stream0=move_6.Geometry, Stream1=dispatch_3.ListB, NullGaps=False)
range_9 = Range(Domain=Domain(0, 1), Steps=Slider(15, range=0..100))
intcrv_6 = Interpolate(Vertices=weave_3, Degree=3, Periodic=False, KnotStyle=1)  # -> Curve, Length, Domain
tweencrv_3 = TweenCurve(CurveA=scale_5.Geometry, CurveB=intcrv_6.Curve, Factor=range_9, BlendType=0)

number_slider_4 = Slider(3, range=0..10)
dom_4 = ConstructDomain(DomainStart=Slider(0, range=0..1), DomainEnd=Slider(1, range=0..1))
Z_8 = UnitZ(Factor=number_slider_4)
pt_5 = ConstructPoint(XCoordinate=0, YCoordinate=0, ZCoordinate=Slider(18, range=0..100))
move_7 = Move(Geometry=scale_6.Geometry, Motion=Z_8)  # -> Geometry, Transform
range_10 = Range(Domain=dom_4, Steps=Slider(100, range=0..100))
eval_4 = EvaluateCurve(Curve=reparameterize(move_7.Geometry), Parameter=range_10)  # -> Point, Tangent, Angle
intcrv_7 = Interpolate(Vertices=eval_4.Point, Degree=3, Periodic=False, KnotStyle=1)  # -> Curve, Length, Domain
neg_4 = Negative(Value=number_slider_4)
dispatch_4 = Dispatch(List=eval_4.Point, DispatchPattern=[True, False])  # -> ListA, ListB
Z_9 = UnitZ(Factor=neg_4)
move_8 = Move(Geometry=dispatch_4.ListA, Motion=Z_9)  # -> Geometry, Transform
range_11 = Range(Domain=Slider(1, range=0..1), Steps=Slider(8, range=0..100))
scale_7 = Scale(Geometry=intcrv_7.Curve, Center=pt_5, Factor=Slider(0.9, range=0..1))  # -> Geometry, Transform
scale_8 = Scale(Geometry=scale_7.Geometry, Center=pt_5, Factor=Slider(0.91, range=0..1))  # -> Geometry, Transform
weave_4 = Weave(Pattern=[0, 1], Stream0=move_8.Geometry, Stream1=dispatch_4.ListB, NullGaps=False)
range_12 = Range(Domain=Domain(0, 1), Steps=Slider(15, range=0..100))
intcrv_8 = Interpolate(Vertices=weave_4, Degree=3, Periodic=False, KnotStyle=1)  # -> Curve, Length, Domain
tweencrv_4 = TweenCurve(CurveA=scale_7.Geometry, CurveB=intcrv_8.Curve, Factor=range_12, BlendType=0)

number_slider_5 = Slider(3, range=0..10)
dom_5 = ConstructDomain(DomainStart=Slider(0, range=0..1), DomainEnd=Slider(1, range=0..1))
Z_10 = UnitZ(Factor=number_slider_5)
pt_6 = ConstructPoint(XCoordinate=0, YCoordinate=0, ZCoordinate=Slider(22.5, range=0..100))
move_9 = Move(Geometry=scale_8.Geometry, Motion=Z_10)  # -> Geometry, Transform
range_13 = Range(Domain=dom_5, Steps=Slider(100, range=0..100))
eval_5 = EvaluateCurve(Curve=reparameterize(move_9.Geometry), Parameter=range_13)  # -> Point, Tangent, Angle
intcrv_9 = Interpolate(Vertices=eval_5.Point, Degree=3, Periodic=False, KnotStyle=1)  # -> Curve, Length, Domain
neg_5 = Negative(Value=number_slider_5)
dispatch_5 = Dispatch(List=eval_5.Point, DispatchPattern=[True, False])  # -> ListA, ListB
Z_11 = UnitZ(Factor=neg_5)
move_10 = Move(Geometry=dispatch_5.ListA, Motion=Z_11)  # -> Geometry, Transform
range_14 = Range(Domain=Slider(1, range=0..1), Steps=Slider(8, range=0..100))
scale_9 = Scale(Geometry=intcrv_9.Curve, Center=pt_6, Factor=Slider(0.9, range=0..1))  # -> Geometry, Transform
scale_10 = Scale(Geometry=scale_9.Geometry, Center=pt_6, Factor=Slider(0.89, range=0..1))  # -> Geometry, Transform
weave_5 = Weave(Pattern=[0, 1], Stream0=move_10.Geometry, Stream1=dispatch_5.ListB, NullGaps=False)
range_15 = Range(Domain=Domain(0, 1), Steps=Slider(15, range=0..100))
intcrv_10 = Interpolate(Vertices=weave_5, Degree=3, Periodic=False, KnotStyle=1)  # -> Curve, Length, Domain
tweencrv_5 = TweenCurve(CurveA=scale_9.Geometry, CurveB=intcrv_10.Curve, Factor=range_15, BlendType=0)

neg_6 = Negative(Value=Slider(13.1, range=0..100))
Z_12 = UnitZ(Factor=1)
neg_7 = Negative(Value=Z_12)
crv = Curve(scale.Geometry)
offset = OffsetCurve(Curve=crv, Distance=neg_6, Corners=1)
Z_13 = UnitZ(Factor=Slider(0.3, range=0..1))

number_slider_6 = Slider(3, range=0..10)
dom_6 = ConstructDomain(DomainStart=Slider(0, range=0..1), DomainEnd=Slider(1, range=0..1))
Z_14 = UnitZ(Factor=number_slider_6)
pt_7 = ConstructPoint(XCoordinate=0, YCoordinate=0, ZCoordinate=Slider(27, range=0..100))
move_11 = Move(Geometry=scale_10.Geometry, Motion=Z_14)  # -> Geometry, Transform
range_16 = Range(Domain=dom_6, Steps=Slider(100, range=0..100))
eval_6 = EvaluateCurve(Curve=reparameterize(move_11.Geometry), Parameter=range_16)  # -> Point, Tangent, Angle
intcrv_11 = Interpolate(Vertices=eval_6.Point, Degree=3, Periodic=False, KnotStyle=1)  # -> Curve, Length, Domain
neg_8 = Negative(Value=number_slider_6)
dispatch_6 = Dispatch(List=eval_6.Point, DispatchPattern=[True, False])  # -> ListA, ListB
Z_15 = UnitZ(Factor=neg_8)
move_12 = Move(Geometry=dispatch_6.ListA, Motion=Z_15)  # -> Geometry, Transform
range_17 = Range(Domain=Slider(1, range=0..1), Steps=Slider(8, range=0..100))
scale_11 = Scale(Geometry=intcrv_11.Curve, Center=pt_7, Factor=Slider(0.9, range=0..1))  # -> Geometry, Transform
scale_12 = Scale(Geometry=scale_11.Geometry, Center=pt_7, Factor=Slider(0.88, range=0..1))  # -> Geometry, Transform
weave_6 = Weave(Pattern=[0, 1], Stream0=move_12.Geometry, Stream1=dispatch_6.ListB, NullGaps=False)
range_18 = Range(Domain=Domain(0, 1), Steps=Slider(15, range=0..100))
intcrv_12 = Interpolate(Vertices=weave_6, Degree=3, Periodic=False, KnotStyle=1)  # -> Curve, Length, Domain
tweencrv_6 = TweenCurve(CurveA=scale_11.Geometry, CurveB=intcrv_12.Curve, Factor=range_18, BlendType=0)

number_slider_7 = Slider(3, range=0..10)
dom_7 = ConstructDomain(DomainStart=Slider(0, range=0..1), DomainEnd=Slider(1, range=0..1))
Z_16 = UnitZ(Factor=number_slider_7)
pt_8 = ConstructPoint(XCoordinate=0, YCoordinate=0, ZCoordinate=Slider(31.5, range=0..100))
move_13 = Move(Geometry=scale_12.Geometry, Motion=Z_16)  # -> Geometry, Transform
range_19 = Range(Domain=dom_7, Steps=Slider(100, range=0..100))
eval_7 = EvaluateCurve(Curve=reparameterize(move_13.Geometry), Parameter=range_19)  # -> Point, Tangent, Angle
intcrv_13 = Interpolate(Vertices=eval_7.Point, Degree=3, Periodic=False, KnotStyle=1)  # -> Curve, Length, Domain
neg_9 = Negative(Value=number_slider_7)
dispatch_7 = Dispatch(List=eval_7.Point, DispatchPattern=[True, False])  # -> ListA, ListB
Z_17 = UnitZ(Factor=neg_9)
move_14 = Move(Geometry=dispatch_7.ListA, Motion=Z_17)  # -> Geometry, Transform
range_20 = Range(Domain=Slider(1, range=0..1), Steps=Slider(8, range=0..100))
scale_13 = Scale(Geometry=intcrv_13.Curve, Center=pt_8, Factor=Slider(0.9, range=0..1))  # -> Geometry, Transform
scale_14 = Scale(Geometry=scale_13.Geometry, Center=pt_8, Factor=Slider(0.9, range=0..1))  # -> Geometry, Transform
weave_7 = Weave(Pattern=[0, 1], Stream0=move_14.Geometry, Stream1=dispatch_7.ListB, NullGaps=False)
range_21 = Range(Domain=Domain(0, 1), Steps=Slider(15, range=0..100))
intcrv_14 = Interpolate(Vertices=weave_7, Degree=3, Periodic=False, KnotStyle=1)  # -> Curve, Length, Domain
tweencrv_7 = TweenCurve(CurveA=scale_13.Geometry, CurveB=intcrv_14.Curve, Factor=range_21, BlendType=0)

line = LineSDL(Start=move_4.Geometry, Direction=neg_7, Length=Slider(3.3, range=0..10))
neg_10 = Negative(Value=Slider(12.2, range=0..100))
crv_2 = Curve(scale_3.Geometry)
extr_2 = Extrude(Base=tweencrv, Direction=Z_13)  # -> graft(Extrusion)
Z_18 = UnitZ(Factor=Slider(0.3, range=0..1))
divide = DivideCurve(Curve=line, Count=Slider(1, range=0..1), Kinks=False)  # -> Points, Tangents, Parameters
neg_11 = Negative(Value=Slider(10.7, range=0..100))
offset_2 = OffsetCurve(Curve=crv_2, Distance=neg_10, Corners=1)
Z_19 = UnitZ(Factor=1)
neg_12 = Negative(Value=Z_19)
crv_3 = Curve(scale_5.Geometry)
neg_13 = Negative(Value=Slider(9.8, range=0..100))
crv_4 = Curve(scale_7.Geometry)
Z_20 = UnitZ(Factor=Slider(0.3, range=0..1))
extr_3 = Extrude(Base=tweencrv_2, Direction=Z_18)  # -> graft(Extrusion)
Z_21 = UnitZ(Factor=1)
neg_14 = Negative(Value=Z_21)
Z_22 = UnitZ(Factor=1)
neg_15 = Negative(Value=Z_22)
offset_3 = OffsetCurve(Curve=crv_3, Distance=neg_11, Corners=1)
offset_4 = OffsetCurve(Curve=crv_4, Distance=neg_13, Corners=1)
line_2 = LineSDL(Start=move_6.Geometry, Direction=neg_12, Length=Slider(6.6, range=0..10))
Z_23 = UnitZ(Factor=Slider(0.3, range=0..1))
extr_4 = Extrude(Base=tweencrv_3, Direction=Z_20)  # -> graft(Extrusion)
culln = CullNth(List=divide.Points, CullFrequency=2)
offsrf = OffsetSurface(Surface=extr_2, Distance=Slider(0.65, range=0..1), BothSides=0, CreateSolid=True)
line_3 = LineSDL(Start=move_8.Geometry, Direction=neg_14, Length=Slider(9.9, range=0..10))
mesh = Mesh([<mesh referenced from the Rhino model> x37])
line_4 = LineSDL(Start=move_10.Geometry, Direction=neg_15, Length=Slider(13.2, range=0..100))
mesh_2 = Mesh(<mesh referenced from the Rhino model>)
extr_5 = Extrude(Base=tweencrv_4, Direction=Z_23)  # -> graft(Extrusion)
neg_16 = Negative(Value=Slider(9, range=0..100))
divide_2 = DivideCurve(Curve=line_2, Count=Slider(1, range=0..1), Kinks=False)  # -> Points, Tangents, Parameters
xy = XYPlane(Origin=culln)
crv_5 = Curve(scale_9.Geometry)
mesh_3 = Mesh(<mesh referenced from the Rhino model>)
bbox = BoundingBox(Content=mesh_2, Plane=PlaneXY(0, 0, 0), UnionBox=True)  # -> Box, Box_2
bbox_2 = BoundingBox(Content=mesh, Plane=PlaneXY(0, 0, 0), UnionBox=True)  # -> Box, Box_2
offsrf_2 = OffsetSurface(Surface=extr_3, Distance=Slider(0.65, range=0..1), BothSides=0, CreateSolid=True)
Z_24 = UnitZ(Factor=Slider(0.3, range=0..1))
offset_5 = OffsetCurve(Curve=crv_5, Distance=neg_16, Corners=1)
mesh_4 = Mesh(<mesh referenced from the Rhino model>)
bbox_3 = BoundingBox(Content=mesh_3, Plane=PlaneXY(0, 0, 0), UnionBox=True)  # -> Box, Box_2
divide_3 = DivideCurve(Curve=line_3, Count=Slider(1, range=0..1), Kinks=False)  # -> Points, Tangents, Parameters
Z_25 = UnitZ(Factor=1)
neg_17 = Negative(Value=Z_25)
extr_6 = Extrude(Base=tweencrv_5, Direction=Z_24)  # -> graft(Extrusion)
debrep = DeconstructBrep(Brep=bbox_2.Box)  # -> Faces, Edges, Vertices
culln_2 = CullNth(List=divide_2.Points, CullFrequency=2)
neg_18 = Negative(Value=Slider(7.6, range=0..100))
bbox_4 = BoundingBox(Content=mesh_4, Plane=PlaneXY(0, 0, 0), UnionBox=True)  # -> Box, Box_2
crv_6 = Curve(scale_11.Geometry)
Z_26 = UnitZ(Factor=1)
neg_19 = Negative(Value=Z_26)
Z_27 = UnitZ(Factor=Slider(0.3, range=0..1))
neg_20 = Negative(Value=Slider(2.9, range=0..100))
offsrf_3 = OffsetSurface(Surface=extr_4, Distance=Slider(0.65, range=0..1), BothSides=0, CreateSolid=True)
crv_7 = Curve(scale_13.Geometry)
offsrf_4 = OffsetSurface(Surface=extr_5, Distance=Slider(0.65, range=0..1), BothSides=0, CreateSolid=True)
xy_2 = XYPlane(Origin=culln_2)
offset_6 = OffsetCurve(Curve=crv_6, Distance=neg_18, Corners=1)
divide_4 = DivideCurve(Curve=line_4, Count=Slider(1, range=0..1), Kinks=False)  # -> Points, Tangents, Parameters
line_5 = LineSDL(Start=move_12.Geometry, Direction=neg_17, Length=Slider(16.5, range=0..100))
culln_3 = CullNth(List=divide_3.Points, CullFrequency=2)
extr_7 = Extrude(Base=tweencrv_6, Direction=Z_27)  # -> graft(Extrusion)
item = ListItem(List=debrep.Faces, Index=Slider(5, range=0..10), Wrap=True)
offset_7 = OffsetCurve(Curve=crv_7, Distance=neg_20, Corners=1)
line_6 = LineSDL(Start=move_14.Geometry, Direction=neg_19, Length=Slider(19, range=0..100))
Z_28 = UnitZ(Factor=Slider(0.3, range=0..1))
offsrf_5 = OffsetSurface(Surface=extr_6, Distance=Slider(0.65, range=0..1), BothSides=0, CreateSolid=True)
xy_3 = XYPlane(Origin=culln_3)
area = Area(Geometry=item)  # -> Area, Centroid
extr_8 = Extrude(Base=tweencrv_7, Direction=Z_28)  # -> graft(Extrusion)
divide_5 = DivideCurve(Curve=line_5, Count=Slider(1, range=0..1), Kinks=False)  # -> Points, Tangents, Parameters
culln_4 = CullNth(List=divide_4.Points, CullFrequency=2)
xy_4 = XYPlane(Origin=area.Centroid)
offsrf_6 = OffsetSurface(Surface=extr_7, Distance=Slider(0.65, range=0..1), BothSides=0, CreateSolid=True)
divide_6 = DivideCurve(Curve=line_6, Count=Slider(1, range=0..1), Kinks=False)  # -> Points, Tangents, Parameters
xy_5 = XYPlane(Origin=culln_4)
orient = Orient(Geometry=mesh, Source=xy_4, Target=xy_3)  # -> Geometry, Transform
orient_2 = Orient(Geometry=mesh, Source=xy_4, Target=xy_2)  # -> Geometry, Transform
culln_5 = CullNth(List=divide_5.Points, CullFrequency=2)
offsrf_7 = OffsetSurface(Surface=extr_8, Distance=Slider(0.65, range=0..1), BothSides=0, CreateSolid=True)
culln_6 = CullNth(List=divide_6.Points, CullFrequency=2)
xy_6 = XYPlane(Origin=culln_5)
orient_3 = Orient(Geometry=mesh, Source=xy_4, Target=xy_5)  # -> Geometry, Transform
xy_7 = XYPlane(Origin=culln_6)
orient_4 = Orient(Geometry=mesh, Source=xy_4, Target=xy_6)  # -> Geometry, Transform
orient_5 = Orient(Geometry=mesh, Source=xy_4, Target=xy_7)  # -> Geometry, Transform
orient_6 = Orient(Geometry=mesh, Source=xy_4, Target=xy)  # -> Geometry, Transform
