# Grasshopper definition staircase 1.gh (Grasshopper 1.0.7)

number_slider = Slider(0, range=0..10)
number_slider_2 = Slider(0, range=0..10)
number_slider_3 = Slider(0, range=0..10)

# ---- group: curve creation using points
pt = ConstructPoint(XCoordinate=0, YCoordinate=0, ZCoordinate=0)
series = Series(Start=Slider(0, range=0..100), Step=Slider(0.69, range=0..1), Count=Slider(17, range=0..100))
graph = GraphMapper(series, x0=0, x1=1.5, y0=0, y1=1, container_name="Sine", Equation_px=[0, 0.3080008328], Equation_py=[0, 1])
number_slider_4 = Slider(10, range=0..10)
Y = UnitY(Factor=1)
Z = UnitZ(Factor=Slider(59, range=0..100))
line = LineSDL(Start=pt, Direction=Y, Length=Slider(1000, range=0..1000))
dom = ConstructDomain(DomainStart=Slider(0, range=0..1), DomainEnd=Slider(1, range=0..1))
range = Range(Domain=dom, Steps=Slider(16, range=0..100))
move = Move(Geometry=line, Motion=Z)  # -> Geometry, Transform
multiplication = Multiplication(A=graph, B=Slider(100, range=0..100))
eval = EvaluateCurve(Curve=move.Geometry, Parameter=range)  # -> Point, Tangent, Angle
Z_2 = UnitZ(Factor=multiplication)
neg = Negative(Value=Z_2)
move_2 = Move(Geometry=eval.Point, Motion=neg)  # -> Geometry, Transform
intcrv_t = InterpolateT(Vertices=move_2.Geometry, TangentStart=Vector(0, 0, 0), TangentEnd=Vector(0, 0, 0), KnotStyle=1)  # -> Curve, Length, Domain

# ----
series_2 = Series(Start=Slider(0, range=0..100), Step=Slider(0.15, range=0..1), Count=Slider(10, range=0..100))
graph_2 = GraphMapper(series_2, x0=0, x1=1.5, y0=0, y1=1, container_name="Sine", Equation_px=[0, 1], Equation_py=[0, 1])
multiplication_2 = Multiplication(A=graph_2, B=Slider(43, range=0..100))
X = UnitX(Factor=multiplication_2)
move_3 = Move(Geometry=move_2.Geometry, Motion=X)  # -> Geometry, Transform
intcrv_t_2 = InterpolateT(Vertices=move_3.Geometry, TangentStart=Vector(0, 0, 0), TangentEnd=Vector(0, 0, 0), KnotStyle=1)  # -> Curve, Length, Domain
crv = Curve(move.Geometry)
crv_2 = Curve(intcrv_t.Curve)
X_2 = UnitX(Factor=Slider(73, range=0..100))
move_4 = Move(Geometry=crv_2, Motion=X_2)  # -> Geometry, Transform
range_2 = Range(Domain=Slider(1, range=0..1), Steps=Slider(8, range=0..100))
tweencrv = TweenCurve(CurveA=crv, CurveB=move_4.Geometry, Factor=range_2, BlendType=0)
flip = FlipMatrix(Data=tweencrv)
Z_3 = UnitZ(Factor=Slider(6, range=0..10))
loft = Loft(Curves=tweencrv, Options={Adjust=False, Closed=False, LoftEnds=0, LoftSimp=0, LoftType=0, Rebuild=10, Refit=0.01})
move_5 = Move(Geometry=tweencrv, Motion=Z_3)  # -> Geometry, Transform
X_3 = UnitX(Factor=Slider(10, range=0..10))
flip_2 = FlipMatrix(Data=move_5.Geometry)
Z_4 = UnitZ(Factor=Slider(25, range=0..100))
extr = Extrude(Base=tweencrv, Direction=X_3)
neg_2 = Negative(Value=Z_4)
move_6 = Move(Geometry=extr, Motion=neg_2)  # -> Geometry, Transform
loft_2 = Loft(Curves=[flip, flip_2], Options={Adjust=False, Closed=False, LoftEnds=0, LoftSimp=0, LoftType=0, Rebuild=10, Refit=0.01})
number_slider_5 = Slider(10, range=0..10)
srfsplit = SurfaceSplit(Surface=loft, Curves=tweencrv)
number_slider_6 = Slider(10, range=0..10)
number_slider_7 = Slider(23, range=0..100)
X_4 = UnitX(Factor=Slider(9, range=5..250))
extr_2 = Extrude(Base=loft_2, Direction=X_4)
offset = OffsetSurface(Surface=move_6.Geometry, Distance=number_slider_7, Retrim=True)
panel = Panel(offset)
divide = DivideDomain²(Domain=offset, UCount=Slider(1, range=0..10), VCount=Slider(38, range=0..100))
mesh = Mesh(<mesh referenced from the Rhino model>)
sbox = SurfaceBox(Surface=graft(offset), Domain=divide, Height=number_slider_7)
bbox = BoundingBox(Content=mesh, Plane=PlaneXY(0, 0, 0))  # -> Box, Box_2
morph = BoxMorph(Geometry=mesh, Reference=bbox.Box, Target=sbox)
