# Grasshopper definition staircase 2.gh (Grasshopper 1.0.7)

crv = Curve(<curve referenced from the Rhino model>)
curvepoint = PointOnCurve(crv, parameter=0)
number_slider = Slider(22, range=0..100)
number_slider_2 = Slider(100000, range=0..100000)
range = Range(Domain=Slider(0.4, range=0.1..1), Steps=Slider(1, range=0..10))
eval = EvaluateCurve(Curve=reparameterize(crv), Parameter=range)  # -> Point, Tangent, Angle
series = Series(Start=curvepoint, Step=Slider(1000, range=0..1000), Count=number_slider)
number_slider_3 = Slider(1000, range=0..1000)
range_2 = Range(Domain=Slider(130500, range=0..1000000), Steps=number_slider)
Y = UnitY(Factor=range_2)
dom = ConstructDomain(DomainStart=Slider(0, range=0..100), DomainEnd=Slider(778, range=0..10000))
number_slider_4 = Slider(10, range=0..10)
range_3 = Range(Domain=dom, Steps=Slider(15, range=0..100))
rad = Radians(Degrees=range_3)
rotate = Rotate(Geometry=crv, Angle=rad, Plane=curvepoint)  # -> Geometry, Transform
series_2 = Series(Start=Slider(0, range=0..100), Step=Slider(6499, range=0..10000), Count=Slider(23, range=0..100))
Z = UnitZ(Factor=series_2)
vec2pt = Vector2Pt(PointA=Y, PointB=Z, Unitize=False)  # -> Vector, Length
move = Move(Geometry=rotate.Geometry, Motion=vec2pt.Vector)  # -> Geometry, Transform
curvepoint_2 = PointOnCurve(move.Geometry, parameter=0)
neg = Negative(Value=Slider(57, range=0..100))
rotate_2 = Rotate(Geometry=move.Geometry, Angle=degrees(neg), Plane=curvepoint_2)  # -> Geometry, Transform
flip = FlipMatrix(Data=move.Geometry)
flip_2 = FlipMatrix(Data=rotate_2.Geometry)
number_slider_5 = Slider(6667, range=0..10000)
loft = Loft(Curves=move.Geometry, Options={Adjust=False, Closed=False, LoftEnds=0, LoftSimp=0, LoftType=0, Rebuild=10, Refit=0.01})
loft_2 = Loft(Curves=[flip, flip_2], Options={Adjust=False, Closed=False, LoftEnds=0, LoftSimp=0, LoftType=0, Rebuild=10, Refit=0.01})
mesh = Mesh(<mesh referenced from the Rhino model>)
Z_2 = UnitZ(Factor=number_slider_5)
Z_3 = UnitZ(Factor=number_slider_5)
extr = Extrude(Base=loft_2, Direction=Z_3)
bbox = BoundingBox(Content=mesh, Plane=PlaneXY(0, 0, 0))  # -> Box, Box_2
move_2 = Move(Geometry=loft_2, Motion=Z_2)  # -> Geometry, Transform
divide = DivideDomain²(Domain=move_2.Geometry, UCount=Slider(1, range=0..10), VCount=Slider(5, range=0..10))
sbox = SurfaceBox(Surface=move_2.Geometry, Domain=divide, Height=number_slider_5)
morph = BoxMorph(Geometry=mesh, Reference=bbox.Box, Target=sbox)
