# Grasshopper definition type 1.gh (Grasshopper 1.0.7)
# plug-ins: Pufferfish

pt = ConstructPoint(XCoordinate=0, YCoordinate=0, ZCoordinate=0)
dom = ConstructDomain(DomainStart=Slider(0, range=0..1), DomainEnd=Slider(1, range=0..1))
cir = Circle(Plane=pt, Radius=Slider(25, range=0..100))
range = Range(Domain=dom, Steps=Slider(15, range=0..100))
eval = EvaluateCurve(Curve=reparameterize(cir), Parameter=range)  # -> Point, Tangent, Angle
intcrv = Interpolate(Vertices=eval.Point, Degree=3, Periodic=False, KnotStyle=1)  # -> Curve, Length, Domain
dom_2 = ConstructDomain(DomainStart=Slider(0, range=0..1), DomainEnd=Slider(1, range=0..1))
dom_3 = ConstructDomain(DomainStart=Slider(0, range=0..1), DomainEnd=Slider(1, range=0..1))
scale = Scale(Geometry=intcrv.Curve, Center=pt, Factor=Slider(0.9, range=0..1))  # -> Geometry, Transform
range_2 = Range(Domain=dom_2, Steps=Slider(36, range=0..100))
range_3 = Range(Domain=dom_3, Steps=Slider(36, range=0..100))
number_slider = Slider(1.5, range=0..10)
eval_2 = EvaluateCurve(Curve=reparameterize(scale.Geometry), Parameter=range_2)  # -> Point, Tangent, Angle
eval_3 = EvaluateCurve(Curve=reparameterize(intcrv.Curve), Parameter=range_3)  # -> Point, Tangent, Angle
dispatch = Dispatch(List=eval_2.Point, DispatchPattern=[True, False])  # -> ListA, ListB
dispatch_2 = Dispatch(List=eval_3.Point, DispatchPattern=[True, False])  # -> ListA, ListB
Z = UnitZ(Factor=number_slider)
pt_2 = Point(dispatch.ListA)
pt_3 = Point(dispatch_2.ListB)
range_4 = Range(Domain=Domain(0, 1), Steps=10)
weave = Weave(Pattern=[0, 1], Stream0=dispatch_2.ListA, Stream1=dispatch.ListB, NullGaps=False)
intcrv_2 = Interpolate(Vertices=weave, Degree=3, Periodic=False, KnotStyle=1)  # -> Curve, Length, Domain
move = Move(Geometry=intcrv_2.Curve, Motion=Z)  # -> Geometry, Transform
tweencrv = TweenCurve(CurveA=move.Geometry, CurveB=intcrv.Curve, Factor=range_4, BlendType=0)

pt_4 = ConstructPoint(XCoordinate=0, YCoordinate=0, ZCoordinate=number_slider)
extr = ExtrudePoint(Base=move.Geometry, Point=pt_4)
Z_2 = UnitZ(Factor=Slider(1.5, range=0..10))
Z_3 = UnitZ(Factor=Slider(3, range=0..10))
Z_4 = UnitZ(Factor=Slider(6, range=0..10))
Z_5 = UnitZ(Factor=Slider(4.5, range=0..10))
Z_6 = UnitZ(Factor=Slider(3, range=0..10))
Z_7 = UnitZ(Factor=Slider(9, range=0..10))
Z_8 = UnitZ(Factor=Slider(7.5, range=0..10))
Z_9 = UnitZ(Factor=Slider(1.5, range=0..10))
Z_10 = UnitZ(Factor=Slider(4.5, range=0..10))
Z_11 = UnitZ(Factor=Slider(10.5, range=0..100))
Z_12 = UnitZ(Factor=Slider(6, range=0..10))
Z_13 = UnitZ(Factor=Slider(10.5, range=0..100))
Z_14 = UnitZ(Factor=Slider(9, range=0..10))
Z_15 = UnitZ(Factor=Slider(7.5, range=0..10))
pt_5 = ConstructPoint(XCoordinate=0, YCoordinate=0, ZCoordinate=0)
pt_6 = ConstructPoint(XCoordinate=0, YCoordinate=0, ZCoordinate=Slider(1.5, range=0..10))
mesh = Mesh([<mesh referenced from the Rhino model> x4])
pt_7 = ConstructPoint(XCoordinate=0, YCoordinate=0, ZCoordinate=0)
number_slider_2 = Slider(1, range=0..1)
pt_8 = ConstructPoint(XCoordinate=0, YCoordinate=0, ZCoordinate=0)
Z_16 = UnitZ(Factor=Slider(0.15, range=0..1))
neg = Negative(Value=Z_16)
box = CenterBox(Base=pt_8, X=number_slider_2, Y=number_slider_2, Z=number_slider_2)
bbox = BoundingBox(Content=box, Plane=PlaneXY(0, 0, 0), UnionBox=True)  # -> Box, Box_2

pt_9 = ConstructPoint(XCoordinate=0, YCoordinate=0, ZCoordinate=0)
cir_2 = Circle(Plane=pt_9, Radius=Slider(25, range=0..100))
dom_4 = ConstructDomain(DomainStart=Slider(0, range=0..1), DomainEnd=Slider(1, range=0..1))
range_5 = Range(Domain=dom_4, Steps=Slider(15, range=0..100))
dom_5 = ConstructDomain(DomainStart=Slider(0, range=0..1), DomainEnd=Slider(1, range=0..1))
dom_6 = ConstructDomain(DomainStart=Slider(0, range=0..1), DomainEnd=Slider(1, range=0..1))
range_6 = Range(Domain=dom_5, Steps=Slider(36, range=0..100))
range_7 = Range(Domain=dom_6, Steps=Slider(36, range=0..100))
Z_17 = UnitZ(Factor=Slider(1.5, range=0..10))
range_8 = Range(Domain=Domain(0, 1), Steps=10)

scale_2 = Scale(Geometry=cir_2, Center=pt_9, Factor=Slider(0.87, range=0..1))  # -> Geometry, Transform

eval_4 = EvaluateCurve(Curve=reparameterize(scale_2.Geometry), Parameter=range_5)  # -> Point, Tangent, Angle
intcrv_3 = Interpolate(Vertices=eval_4.Point, Degree=3, Periodic=False, KnotStyle=1)  # -> Curve, Length, Domain
scale_3 = Scale(Geometry=intcrv_3.Curve, Center=pt_9, Factor=Slider(0.9, range=0..1))  # -> Geometry, Transform
eval_5 = EvaluateCurve(Curve=reparameterize(scale_3.Geometry), Parameter=range_6)  # -> Point, Tangent, Angle
eval_6 = EvaluateCurve(Curve=reparameterize(intcrv_3.Curve), Parameter=range_7)  # -> Point, Tangent, Angle
dispatch_3 = Dispatch(List=eval_5.Point, DispatchPattern=[True, False])  # -> ListA, ListB
dispatch_4 = Dispatch(List=eval_6.Point, DispatchPattern=[True, False])  # -> ListA, ListB
pt_10 = Point(dispatch_3.ListA)
pt_11 = Point(dispatch_4.ListB)
weave_2 = Weave(Pattern=[0, 1], Stream0=dispatch_4.ListA, Stream1=dispatch_3.ListB, NullGaps=False)
intcrv_4 = Interpolate(Vertices=weave_2, Degree=3, Periodic=False, KnotStyle=1)  # -> Curve, Length, Domain
move_2 = Move(Geometry=intcrv_4.Curve, Motion=Z_17)  # -> Geometry, Transform
tweencrv_2 = TweenCurve(CurveA=move_2.Geometry, CurveB=intcrv_3.Curve, Factor=range_8, BlendType=0)

move_3 = Move(Geometry=tweencrv_2, Motion=Z_2)  # -> Geometry, Transform
move_4 = Move(Geometry=move_2.Geometry, Motion=Z_9)  # -> Geometry, Transform
extr_2 = ExtrudePoint(Base=move_4.Geometry, Point=pt_6)

pt_12 = ConstructPoint(XCoordinate=0, YCoordinate=0, ZCoordinate=0)
cir_3 = Circle(Plane=pt_12, Radius=Slider(25, range=0..100))
dom_7 = ConstructDomain(DomainStart=Slider(0, range=0..1), DomainEnd=Slider(1, range=0..1))
range_9 = Range(Domain=dom_7, Steps=Slider(15, range=0..100))
dom_8 = ConstructDomain(DomainStart=Slider(0, range=0..1), DomainEnd=Slider(1, range=0..1))
dom_9 = ConstructDomain(DomainStart=Slider(0, range=0..1), DomainEnd=Slider(1, range=0..1))
range_10 = Range(Domain=dom_8, Steps=Slider(36, range=0..100))
range_11 = Range(Domain=dom_9, Steps=Slider(36, range=0..100))
Z_18 = UnitZ(Factor=Slider(1.5, range=0..10))
range_12 = Range(Domain=Domain(0, 1), Steps=10)

scale_4 = Scale(Geometry=cir_3, Center=pt_12, Factor=Slider(0.75, range=0..1))  # -> Geometry, Transform

eval_7 = EvaluateCurve(Curve=reparameterize(scale_4.Geometry), Parameter=range_9)  # -> Point, Tangent, Angle
intcrv_5 = Interpolate(Vertices=eval_7.Point, Degree=3, Periodic=False, KnotStyle=1)  # -> Curve, Length, Domain
scale_5 = Scale(Geometry=intcrv_5.Curve, Center=pt_12, Factor=Slider(0.9, range=0..1))  # -> Geometry, Transform
eval_8 = EvaluateCurve(Curve=reparameterize(scale_5.Geometry), Parameter=range_10)  # -> Point, Tangent, Angle
eval_9 = EvaluateCurve(Curve=reparameterize(intcrv_5.Curve), Parameter=range_11)  # -> Point, Tangent, Angle
dispatch_5 = Dispatch(List=eval_8.Point, DispatchPattern=[True, False])  # -> ListA, ListB
dispatch_6 = Dispatch(List=eval_9.Point, DispatchPattern=[True, False])  # -> ListA, ListB
pt_13 = Point(dispatch_5.ListA)
pt_14 = Point(dispatch_6.ListB)
weave_3 = Weave(Pattern=[0, 1], Stream0=dispatch_6.ListA, Stream1=dispatch_5.ListB, NullGaps=False)
intcrv_6 = Interpolate(Vertices=weave_3, Degree=3, Periodic=False, KnotStyle=1)  # -> Curve, Length, Domain
move_5 = Move(Geometry=intcrv_6.Curve, Motion=Z_18)  # -> Geometry, Transform
tweencrv_3 = TweenCurve(CurveA=move_5.Geometry, CurveB=intcrv_5.Curve, Factor=range_12, BlendType=0)

move_6 = Move(Geometry=tweencrv_3, Motion=Z_3)  # -> Geometry, Transform
move_7 = Move(Geometry=move_5.Geometry, Motion=Z_6)  # -> Geometry, Transform

pt_15 = ConstructPoint(XCoordinate=0, YCoordinate=0, ZCoordinate=0)
cir_4 = Circle(Plane=pt_15, Radius=Slider(25, range=0..100))
dom_10 = ConstructDomain(DomainStart=Slider(0, range=0..1), DomainEnd=Slider(1, range=0..1))
range_13 = Range(Domain=dom_10, Steps=Slider(15, range=0..100))
dom_11 = ConstructDomain(DomainStart=Slider(0, range=0..1), DomainEnd=Slider(1, range=0..1))
dom_12 = ConstructDomain(DomainStart=Slider(0, range=0..1), DomainEnd=Slider(1, range=0..1))
range_14 = Range(Domain=dom_11, Steps=Slider(36, range=0..100))
range_15 = Range(Domain=dom_12, Steps=Slider(36, range=0..100))
Z_19 = UnitZ(Factor=Slider(1.5, range=0..10))
range_16 = Range(Domain=Domain(0, 1), Steps=10)

scale_6 = Scale(Geometry=cir_4, Center=pt_15, Factor=Slider(0.54, range=0..1))  # -> Geometry, Transform

eval_10 = EvaluateCurve(Curve=reparameterize(scale_6.Geometry), Parameter=range_13)  # -> Point, Tangent, Angle
intcrv_7 = Interpolate(Vertices=eval_10.Point, Degree=3, Periodic=False, KnotStyle=1)  # -> Curve, Length, Domain
scale_7 = Scale(Geometry=intcrv_7.Curve, Center=pt_15, Factor=Slider(0.9, range=0..1))  # -> Geometry, Transform
eval_11 = EvaluateCurve(Curve=reparameterize(scale_7.Geometry), Parameter=range_14)  # -> Point, Tangent, Angle
eval_12 = EvaluateCurve(Curve=reparameterize(intcrv_7.Curve), Parameter=range_15)  # -> Point, Tangent, Angle
dispatch_7 = Dispatch(List=eval_11.Point, DispatchPattern=[True, False])  # -> ListA, ListB
dispatch_8 = Dispatch(List=eval_12.Point, DispatchPattern=[True, False])  # -> ListA, ListB
pt_16 = Point(dispatch_7.ListA)
pt_17 = Point(dispatch_8.ListB)
weave_4 = Weave(Pattern=[0, 1], Stream0=dispatch_8.ListA, Stream1=dispatch_7.ListB, NullGaps=False)
intcrv_8 = Interpolate(Vertices=weave_4, Degree=3, Periodic=False, KnotStyle=1)  # -> Curve, Length, Domain
move_8 = Move(Geometry=intcrv_8.Curve, Motion=Z_19)  # -> Geometry, Transform
tweencrv_4 = TweenCurve(CurveA=move_8.Geometry, CurveB=intcrv_7.Curve, Factor=range_16, BlendType=0)

move_9 = Move(Geometry=tweencrv_4, Motion=Z_4)  # -> Geometry, Transform
move_10 = Move(Geometry=move_8.Geometry, Motion=Z_12)  # -> Geometry, Transform

pt_18 = ConstructPoint(XCoordinate=0, YCoordinate=0, ZCoordinate=0)
cir_5 = Circle(Plane=pt_18, Radius=Slider(25, range=0..100))
dom_13 = ConstructDomain(DomainStart=Slider(0, range=0..1), DomainEnd=Slider(1, range=0..1))
range_17 = Range(Domain=dom_13, Steps=Slider(15, range=0..100))
dom_14 = ConstructDomain(DomainStart=Slider(0, range=0..1), DomainEnd=Slider(1, range=0..1))
dom_15 = ConstructDomain(DomainStart=Slider(0, range=0..1), DomainEnd=Slider(1, range=0..1))
range_18 = Range(Domain=dom_14, Steps=Slider(36, range=0..100))
range_19 = Range(Domain=dom_15, Steps=Slider(36, range=0..100))
Z_20 = UnitZ(Factor=Slider(1.5, range=0..10))
range_20 = Range(Domain=Domain(0, 1), Steps=10)

scale_8 = Scale(Geometry=cir_5, Center=pt_18, Factor=Slider(0.64, range=0..1))  # -> Geometry, Transform

eval_13 = EvaluateCurve(Curve=reparameterize(scale_8.Geometry), Parameter=range_17)  # -> Point, Tangent, Angle
intcrv_9 = Interpolate(Vertices=eval_13.Point, Degree=3, Periodic=False, KnotStyle=1)  # -> Curve, Length, Domain
scale_9 = Scale(Geometry=intcrv_9.Curve, Center=pt_18, Factor=Slider(0.9, range=0..1))  # -> Geometry, Transform
eval_14 = EvaluateCurve(Curve=reparameterize(scale_9.Geometry), Parameter=range_18)  # -> Point, Tangent, Angle
eval_15 = EvaluateCurve(Curve=reparameterize(intcrv_9.Curve), Parameter=range_19)  # -> Point, Tangent, Angle
dispatch_9 = Dispatch(List=eval_14.Point, DispatchPattern=[True, False])  # -> ListA, ListB
dispatch_10 = Dispatch(List=eval_15.Point, DispatchPattern=[True, False])  # -> ListA, ListB
pt_19 = Point(dispatch_9.ListA)
pt_20 = Point(dispatch_10.ListB)
weave_5 = Weave(Pattern=[0, 1], Stream0=dispatch_10.ListA, Stream1=dispatch_9.ListB, NullGaps=False)
intcrv_10 = Interpolate(Vertices=weave_5, Degree=3, Periodic=False, KnotStyle=1)  # -> Curve, Length, Domain
move_11 = Move(Geometry=intcrv_10.Curve, Motion=Z_20)  # -> Geometry, Transform
tweencrv_5 = TweenCurve(CurveA=move_11.Geometry, CurveB=intcrv_9.Curve, Factor=range_20, BlendType=0)

move_12 = Move(Geometry=tweencrv_5, Motion=Z_5)  # -> Geometry, Transform
move_13 = Move(Geometry=move_11.Geometry, Motion=Z_10)  # -> Geometry, Transform

pt_21 = ConstructPoint(XCoordinate=0, YCoordinate=0, ZCoordinate=0)
cir_6 = Circle(Plane=pt_21, Radius=Slider(25, range=0..100))
dom_16 = ConstructDomain(DomainStart=Slider(0, range=0..1), DomainEnd=Slider(1, range=0..1))
range_21 = Range(Domain=dom_16, Steps=Slider(15, range=0..100))
dom_17 = ConstructDomain(DomainStart=Slider(0, range=0..1), DomainEnd=Slider(1, range=0..1))
dom_18 = ConstructDomain(DomainStart=Slider(0, range=0..1), DomainEnd=Slider(1, range=0..1))
range_22 = Range(Domain=dom_17, Steps=Slider(36, range=0..100))
range_23 = Range(Domain=dom_18, Steps=Slider(36, range=0..100))
Z_21 = UnitZ(Factor=Slider(1.5, range=0..10))
range_24 = Range(Domain=Domain(0, 1), Steps=10)

scale_10 = Scale(Geometry=cir_6, Center=pt_21, Factor=Slider(0.37, range=0..1))  # -> Geometry, Transform

eval_16 = EvaluateCurve(Curve=reparameterize(scale_10.Geometry), Parameter=range_21)  # -> Point, Tangent, Angle
intcrv_11 = Interpolate(Vertices=eval_16.Point, Degree=3, Periodic=False, KnotStyle=1)  # -> Curve, Length, Domain
scale_11 = Scale(Geometry=intcrv_11.Curve, Center=pt_21, Factor=Slider(0.9, range=0..1))  # -> Geometry, Transform
eval_17 = EvaluateCurve(Curve=reparameterize(scale_11.Geometry), Parameter=range_22)  # -> Point, Tangent, Angle
eval_18 = EvaluateCurve(Curve=reparameterize(intcrv_11.Curve), Parameter=range_23)  # -> Point, Tangent, Angle
dispatch_11 = Dispatch(List=eval_17.Point, DispatchPattern=[True, False])  # -> ListA, ListB
dispatch_12 = Dispatch(List=eval_18.Point, DispatchPattern=[True, False])  # -> ListA, ListB
pt_22 = Point(dispatch_11.ListA)
pt_23 = Point(dispatch_12.ListB)
weave_6 = Weave(Pattern=[0, 1], Stream0=dispatch_12.ListA, Stream1=dispatch_11.ListB, NullGaps=False)
intcrv_12 = Interpolate(Vertices=weave_6, Degree=3, Periodic=False, KnotStyle=1)  # -> Curve, Length, Domain
move_14 = Move(Geometry=intcrv_12.Curve, Motion=Z_21)  # -> Geometry, Transform
tweencrv_6 = TweenCurve(CurveA=move_14.Geometry, CurveB=intcrv_11.Curve, Factor=range_24, BlendType=0)

move_15 = Move(Geometry=tweencrv_6, Motion=Z_7)  # -> Geometry, Transform
move_16 = Move(Geometry=move_14.Geometry, Motion=Z_14)  # -> Geometry, Transform

pt_24 = ConstructPoint(XCoordinate=0, YCoordinate=0, ZCoordinate=0)
cir_7 = Circle(Plane=pt_24, Radius=Slider(25, range=0..100))
dom_19 = ConstructDomain(DomainStart=Slider(0, range=0..1), DomainEnd=Slider(1, range=0..1))
range_25 = Range(Domain=dom_19, Steps=Slider(15, range=0..100))
dom_20 = ConstructDomain(DomainStart=Slider(0, range=0..1), DomainEnd=Slider(1, range=0..1))
dom_21 = ConstructDomain(DomainStart=Slider(0, range=0..1), DomainEnd=Slider(1, range=0..1))
range_26 = Range(Domain=dom_20, Steps=Slider(36, range=0..100))
range_27 = Range(Domain=dom_21, Steps=Slider(36, range=0..100))
Z_22 = UnitZ(Factor=Slider(1.5, range=0..10))
range_28 = Range(Domain=Domain(0, 1), Steps=10)

scale_12 = Scale(Geometry=cir_7, Center=pt_24, Factor=Slider(0.45, range=0..1))  # -> Geometry, Transform

eval_19 = EvaluateCurve(Curve=reparameterize(scale_12.Geometry), Parameter=range_25)  # -> Point, Tangent, Angle
intcrv_13 = Interpolate(Vertices=eval_19.Point, Degree=3, Periodic=False, KnotStyle=1)  # -> Curve, Length, Domain
scale_13 = Scale(Geometry=intcrv_13.Curve, Center=pt_24, Factor=Slider(0.9, range=0..1))  # -> Geometry, Transform
eval_20 = EvaluateCurve(Curve=reparameterize(scale_13.Geometry), Parameter=range_26)  # -> Point, Tangent, Angle
eval_21 = EvaluateCurve(Curve=reparameterize(intcrv_13.Curve), Parameter=range_27)  # -> Point, Tangent, Angle
dispatch_13 = Dispatch(List=eval_20.Point, DispatchPattern=[True, False])  # -> ListA, ListB
dispatch_14 = Dispatch(List=eval_21.Point, DispatchPattern=[True, False])  # -> ListA, ListB
pt_25 = Point(dispatch_13.ListA)
pt_26 = Point(dispatch_14.ListB)
weave_7 = Weave(Pattern=[0, 1], Stream0=dispatch_14.ListA, Stream1=dispatch_13.ListB, NullGaps=False)
intcrv_14 = Interpolate(Vertices=weave_7, Degree=3, Periodic=False, KnotStyle=1)  # -> Curve, Length, Domain
move_17 = Move(Geometry=intcrv_14.Curve, Motion=Z_22)  # -> Geometry, Transform
tweencrv_7 = TweenCurve(CurveA=move_17.Geometry, CurveB=intcrv_13.Curve, Factor=range_28, BlendType=0)

move_18 = Move(Geometry=tweencrv_7, Motion=Z_8)  # -> Geometry, Transform
move_19 = Move(Geometry=move_17.Geometry, Motion=Z_15)  # -> Geometry, Transform

pt_27 = ConstructPoint(XCoordinate=0, YCoordinate=0, ZCoordinate=0)
cir_8 = Circle(Plane=pt_27, Radius=Slider(25, range=0..100))
dom_22 = ConstructDomain(DomainStart=Slider(0, range=0..1), DomainEnd=Slider(1, range=0..1))
range_29 = Range(Domain=dom_22, Steps=Slider(15, range=0..100))
dom_23 = ConstructDomain(DomainStart=Slider(0, range=0..1), DomainEnd=Slider(1, range=0..1))
dom_24 = ConstructDomain(DomainStart=Slider(0, range=0..1), DomainEnd=Slider(1, range=0..1))
range_30 = Range(Domain=dom_23, Steps=Slider(36, range=0..100))
range_31 = Range(Domain=dom_24, Steps=Slider(36, range=0..100))
Z_23 = UnitZ(Factor=Slider(1.5, range=0..10))
range_32 = Range(Domain=Domain(0, 1), Steps=10)

scale_14 = Scale(Geometry=cir_8, Center=pt_27, Factor=Slider(0.3, range=0..1))  # -> Geometry, Transform

eval_22 = EvaluateCurve(Curve=reparameterize(scale_14.Geometry), Parameter=range_29)  # -> Point, Tangent, Angle
intcrv_15 = Interpolate(Vertices=eval_22.Point, Degree=3, Periodic=False, KnotStyle=1)  # -> Curve, Length, Domain
scale_15 = Scale(Geometry=intcrv_15.Curve, Center=pt_27, Factor=Slider(0.9, range=0..1))  # -> Geometry, Transform
eval_23 = EvaluateCurve(Curve=reparameterize(scale_15.Geometry), Parameter=range_30)  # -> Point, Tangent, Angle
eval_24 = EvaluateCurve(Curve=reparameterize(intcrv_15.Curve), Parameter=range_31)  # -> Point, Tangent, Angle
dispatch_15 = Dispatch(List=eval_23.Point, DispatchPattern=[True, False])  # -> ListA, ListB
dispatch_16 = Dispatch(List=eval_24.Point, DispatchPattern=[True, False])  # -> ListA, ListB
pt_28 = Point(dispatch_15.ListA)
pt_29 = Point(dispatch_16.ListB)
weave_8 = Weave(Pattern=[0, 1], Stream0=dispatch_16.ListA, Stream1=dispatch_15.ListB, NullGaps=False)
intcrv_16 = Interpolate(Vertices=weave_8, Degree=3, Periodic=False, KnotStyle=1)  # -> Curve, Length, Domain
move_20 = Move(Geometry=intcrv_16.Curve, Motion=Z_23)  # -> Geometry, Transform
tweencrv_8 = TweenCurve(CurveA=move_20.Geometry, CurveB=intcrv_15.Curve, Factor=range_32, BlendType=0)

move_21 = Move(Geometry=tweencrv_8, Motion=Z_11)  # -> Geometry, Transform
move_22 = Move(Geometry=move_20.Geometry, Motion=Z_13)  # -> Geometry, Transform
rotate = Rotate(
    Geometry=[move_4.Geometry, move_13.Geometry, move_19.Geometry, move_22.Geometry],
    Angle=degrees(Slider(50, range=0..100)),
    Plane=pt_5)  # -> Geometry, Transform
rotate_2 = Rotate(
    Geometry=[move_3.Geometry, move_12.Geometry, move_18.Geometry, move_21.Geometry],
    Angle=degrees(Slider(50, range=0..100)),
    Plane=pt_7)  # -> Geometry, Transform
crv = Curve([move_15.Geometry, move_9.Geometry, move_6.Geometry, tweencrv, rotate_2.Geometry])
extr_3 = Extrude(Base=crv, Direction=neg)
divide = DivideDomain²(Domain=extr_3, UCount=Slider(1, range=0..1), VCount=Slider(500, range=0..1000))
sbox = SurfaceBox(Surface=graft(extr_3), Domain=divide, Height=Slider(0.3, range=0..1))
subsrf = Isotrim(Surface=graft(extr_3), Domain=divide)
offsrf = OffsetSurface(Surface=extr_3, Distance=Slider(0.3, range=0..1), BothSides=0, CreateSolid=True)
morph = BoxMorph(Geometry=box, Reference=bbox.Box, Target=sbox)
